# Grasshopper definition Basic_Routing.gh (Grasshopper 1.0.7)
# plug-ins: RabbitMQ.GH

credentials = Credentials()
panel = Panel("""payment
global""")
panel_2 = Panel("""analysis
global""")
boolean_toggle = BooleanToggle(False)
comsumer = Comsumer(
    Run=boolean_toggle,
    Host="rq.desfab.xyz",
    Port=Slider(8432, range=0..10000),
    Exchange="basic_routing",
    ExchangeType=Slider(1, range=0..2),
    RoutingKeys=panel_2)  # -> Received, Counter, Timer
comsumer_2 = Comsumer(
    Run=boolean_toggle,
    Host="rq.desfab.xyz",
    Port=Slider(8432, range=0..10000),
    Exchange="basic_routing",
    ExchangeType=Slider(1, range=0..2),
    RoutingKeys=panel)  # -> Received, Counter, Timer
panel_3 = Panel(comsumer.Received)
panel_4 = Panel(comsumer_2.Received)
