# Grasshopper definition Client.gh (Grasshopper 1.0.7)
# plug-ins: RabbitMQ.GH

credentials = Credentials()
client = Client(
    Run=Toggle(False),
    Host="rq.desfab.xyz",
    Port=Slider(8432, range=0..10000),
    Body="SomeDataFrom gh2",
    Queue="request_queue",
    Exchange="request_exchange")
panel = Panel(client)
