# Grasshopper definition Competing_Consumers.gh (Grasshopper 1.0.7)
# plug-ins: RabbitMQ.GH

credentials = Credentials()
boolean_toggle = BooleanToggle(False)
number_slider = Slider(8432, range=0..10000)
c_script = CSharpScript(Reference=["C:\Users\liors\AppData\Roaming\Grasshopper\Libraries\test\Newtonsoft.Json.dll", "C:\Users\liors\AppData\Roaming\Grasshopper\Libraries\test\RabbitMQ.Client.dll", "C:\Users\liors\AppData\Roaming\Grasshopper\Libraries\test\RabbitMQ.Core.dll", "C:\Users\liors\AppData\Roaming\Grasshopper\Libraries\test\System.Buffers.dll", "C:\Users\liors\AppData\Roaming\Grasshopper\Libraries\test\System.Memory.dll", "C:\Users\liors\AppData\Roaming\Grasshopper\Libraries\test\System.Numerics.Vectors.dll", "C:\Users\liors\AppData\Roaming\Grasshopper\Libraries\test\System.Runtime.CompilerServices.Unsafe.dll", "C:\Users\liors\AppData\Roaming\Grasshopper\Libraries\test\System.Threading.Channels.dll", "C:\Users\liors\AppData\Roaming\Grasshopper\Libraries\test\System.Threading.Tasks.Extensions.dll"])  # -> out, A
# ---------- c_script: C# usings ----------
using RabbitMQ.Core;
using System.Linq;
using RabbitMQ.Client;
using RabbitMQ.Client.Events;
using Newtonsoft.Json;
using System.Text;
# ---------- c_script: C# ----------
    A = costumHandler;
# ---------- c_script: C# additional code ----------
  public RabbitMQ.Core.Handler costumHandler = new CostumHandler();

  public class CostumHandler:RabbitMQ.Core.Handler
  {

    public CostumHandler() : base() { }

    public override List<object> HandleMessage(string body)
    {
      var doubleList = JsonConvert.DeserializeObject<List<List<double>>>(body);
      List<Point3d> points = new List<Point3d>();
      foreach (List<double> val in doubleList)
      {
        var point = new Point3d(val[0], val[1], val[2]);
        points.Add(point);
      }

      Curve c = Curve.CreateControlPointCurve(points, 1);
      List < object > curve = new List<object>(){c};

      RhinoApp.WriteLine("Message is in the handler object.");
      return curve;

    }
  }
# ---------- end c_script ----------
boolean_toggle_2 = BooleanToggle(True)
comsumer = Comsumer(Run=boolean_toggle, Host="rq.desfab.xyz", Port=number_slider, Queue="letterbox_cs1", Competing=boolean_toggle_2)  # -> Received, Counter, Timer
comsumer_2 = Comsumer(Run=boolean_toggle, Host="rq.desfab.xyz", Port=number_slider, Queue="letterbox_cs1", Competing=boolean_toggle_2)  # -> Received, Counter, Timer
comsumer_3 = Comsumer(Run=boolean_toggle, Host="rq.desfab.xyz", Port=number_slider, Queue="letterbox_cs1", Competing=boolean_toggle_2)  # -> Received, Counter, Timer
panel = Panel(comsumer.Received)
panel_2 = Panel(comsumer_3.Received)
panel_3 = Panel(comsumer_2.Received)
