# Grasshopper definition Object Conversion.gh (Grasshopper 1.0.7)
# plug-ins: RabbitMQ.GH

orient = Orient(Source=PlaneXY(0, 0, 0), Target=PlaneXY(0, 0, 0))  # -> Geometry, Transform
transform = Transform(orient.Transform)
point = Point(Point(6.618231087, 7.862259487, 0))
xy_plane = XYPlane(Origin=Point(0, 0, 0))
point_2 = Point(Point(-0.9454615839, 7.862259487, 0))
line = Line(StartPoint=point_2, EndPoint=point)
vector = Vector(point_2)
curve = Curve(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)
surface = Surface(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)
brep = Brep(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)
mesh = Mesh(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)
merge = Merge(
    Data1=point_2,
    Data2=vector,
    Data3=xy_plane,
    Data4=line,
    Data5=curve,
    Data6=surface,
    Data7=brep,
    Data8=mesh,
    Data9=transform,
    Data10="fdghdf")
c_script = CSharpScript(x=merge, Reference="C:\Users\liors\AppData\Roaming\Grasshopper\Libraries\test\Newtonsoft.Json.dll")  # -> out, A; inputs x: list
# ---------- c_script: C# usings ----------
using Newtonsoft.Json;
using Newtonsoft.Json.Bson;
using System.IO;
using Rhino.FileIO;
using System.Linq;
# ---------- c_script: C# ----------
    List<String> jsons = new List<String>();
    var jsonOptions = new SerializationOptions();
    String so = null;
    foreach (object o in x)
    {
      var t = o.GetType().ToString();
      Print(t);
      try
      {
        var go = (GeometryBase) (o);
        so = go.ToJSON(jsonOptions);
      }
      catch
      {
        so = o.ToString();
      }
      
      Dictionary < String,String > data = new Dictionary<String,String>{{t,so}};
      
      var jsonObj = JsonConvert.SerializeObject(data);

      jsons.Add(jsonObj);
      
    }

    A = jsons;
# ---------- end c_script ----------
rhinotostring = RhinoToString(Objects=merge)  # -> JsonString, Errors
stringtorhino = StringToRhino(SObjects=rhinotostring.JsonString)  # -> Objects, Errors
c_script_2 = CSharpScript(x=rhinotostring.JsonString, Reference="C:\Users\liors\AppData\Roaming\Grasshopper\Libraries\test\Newtonsoft.Json.dll")  # -> out, A; inputs x: list of String
# ---------- c_script_2: C# usings ----------
using Newtonsoft.Json;
using System.Linq;
using System.Text;
# ---------- c_script_2: C# ----------
    List<object> objects = new List<object>();


    for (int i = 0;i < x.Count;i++)
    {
      Dictionary<String,String> data = Newtonsoft.Json.JsonConvert.DeserializeObject<Dictionary<String,String>>(x[i]);
      string[] keys = data.Keys.ToArray();
      try
      {

        var o = GeometryBase.FromJSON(data[keys[0]]);
        objects.Add(o);
      }
      catch
      {
        if (keys[0].Contains("Point"))
        {
          var o = Point3d.Unset;
          Point3d.TryParse(data[keys[0]], out o);
          objects.Add(o);
        }
        else if (keys[0].Contains("Vector"))
        {
          var temp = Point3d.Unset;
          Point3d.TryParse(data[keys[0]], out temp);
          var o = new Vector3d(temp);
          objects.Add(o);
        }
        else if (keys[0].Contains("Plane"))
        {
          string[] parts = data[keys[0]].Split(' ');
          string[] originValues = parts[0].Split('=')[1].Split(',');
          var origin = new Point3d(double.Parse(originValues[0]), double.Parse(originValues[1]), double.Parse(originValues[2]));


          var vectors = new Vector3d[3];
          for (int j = 0; j < 3; j++)
          {
            string[] vectorValues = parts[j + 1].Split('=')[1].Split(',');
            vectors[j] = new Vector3d(double.Parse(vectorValues[0]), double.Parse(vectorValues[1]), double.Parse(vectorValues[2]));
          }
          var o = new Plane(origin, vectors[0], vectors[1]);
          objects.Add(o);
        }
        else if (keys[0].Contains("Line"))
        {
          string[] parts = data[keys[0]].Split(',');
          var p1 = new Point3d(double.Parse(parts[0]), double.Parse(parts[1]), double.Parse(parts[2]));
          var p2 = new Point3d(double.Parse(parts[3]), double.Parse(parts[4]), double.Parse(parts[5]));
          var o = new Line(p1, p2);
          objects.Add(o);
        }
        else if (keys[0].Contains("Transform"))
        {
          var numbers = data[keys[0]].Split(new[] { '=', '(', ')', ',' }, StringSplitOptions.RemoveEmptyEntries).ToList();
          numbers = numbers.Where((item, index) => index != 0 && index != 5 && index != 10 && index != 15).ToList();
          var transform = new Transform();
          for (int j = 0; j < 4; j++)
          {
            for (int k = 0; k < 4; k++)
            {
              transform[j, k] = double.Parse(numbers[j * 4 + k]);
            }
          }
          objects.Add(transform);
          
        }
        else
        {
          objects.Add("Invalid format in input number - " + i.ToString());
        }
      }
    }

    A = objects;
# ---------- end c_script_2 ----------
panel = Panel(c_script.A)
