# Grasshopper definition Producer.gh (Grasshopper 1.0.7)
# plug-ins: RabbitMQ.GH

panel = Panel("""analysis
payment
global""")
panel_2 = Panel("""GH_analysis message
GH_payment message
GH_global message""")
panel_3 = Panel("""user.europe.payments
user.europe.analysis
user.asia.payments""")
panel_4 = Panel("""This is a message from GH
This is another message from GH--2
This is another message from GH--3""")
panel_5 = Panel("""GH_ A european user paid for something - user.europe.payments
GH_ A european business ordered goods - user.europe.analysis
GH_ A european business place a payment - for the goods user.asia.payments""")
credentials = Credentials()
producer = Producer(
    Run=Button(),
    Host="rq.desfab.xyz",
    Port=Slider(8432, range=0..10000),
    Body=panel_2,
    Exchange="basic_routing",
    ExchangeType=Slider(1, range=0..1),
    RoutingKeys=panel)
producer_2 = Producer(
    Run=Button(),
    Host="rq.desfab.xyz",
    Port=Slider(8432, range=0..10000),
    Body=panel_5,
    Exchange="topic_routing",
    ExchangeType=Slider(2, range=0..2),
    RoutingKeys=panel_3)
producer_3 = Producer(
    Run=Button(),
    Host="rq.desfab.xyz",
    Port=Slider(8432, range=0..10000),
    Body="This is a message from GH",
    Queue="letterbox")
producer_4 = Producer(
    Run=Button(),
    Host="rq.desfab.xyz",
    Port=Slider(8432, range=0..10000),
    Body=panel_4,
    Exchange="pubsub",
    ExchangeType=Slider(0, range=0..100))
