# Grasshopper definition PubSub.gh (Grasshopper 1.0.7)
# plug-ins: RabbitMQ.GH

credentials = Credentials()
number_slider = Slider(0, range=0..100)
boolean_toggle = BooleanToggle(False)
number_slider_2 = Slider(8432, range=0..10000)
comsumer = Comsumer(Run=boolean_toggle, Host="rq.desfab.xyz", Port=number_slider_2, Exchange="pubsub", ExchangeType=number_slider)  # -> Received, Counter, Timer
comsumer_2 = Comsumer(Run=boolean_toggle, Host="rq.desfab.xyz", Port=number_slider_2, Exchange="pubsub", ExchangeType=number_slider)  # -> Received, Counter, Timer
panel = Panel(comsumer.Received)
panel_2 = Panel(comsumer_2.Received)
