# Grasshopper definition Server.gh (Grasshopper 1.0.7)
# plug-ins: RabbitMQ.GH

credentials = Credentials()
panel = Panel("SomeDataFrom gh2")
server = Server(
    Run=Toggle(False),
    Host="rq.desfab.xyz",
    Port=Slider(8432, range=0..10000),
    Exchange="request_exchange",
    RoutingKeys="request_queue")  # -> Received, Counter, Timer
panel_2 = Panel(server.Received)
