# Grasshopper definition Topic_Routing.gh (Grasshopper 1.0.7)
# plug-ins: RabbitMQ.GH

boolean_toggle = BooleanToggle(False)
number_slider = Slider(8432, range=0..10000)
number_slider_2 = Slider(2, range=0..2)
comsumer = Comsumer(
    Run=boolean_toggle,
    Host="rq.desfab.xyz",
    Port=number_slider,
    Exchange="topic_routing",
    ExchangeType=number_slider_2,
    RoutingKeys="*.europe.*")  # -> Received, Counter, Timer
comsumer_2 = Comsumer(
    Run=boolean_toggle,
    Host="rq.desfab.xyz",
    Port=number_slider,
    Exchange="topic_routing",
    ExchangeType=number_slider_2,
    RoutingKeys="#.payments")  # -> Received, Counter, Timer
comsumer_3 = Comsumer(
    Run=boolean_toggle,
    Host="rq.desfab.xyz",
    Port=number_slider,
    Exchange="topic_routing",
    ExchangeType=number_slider_2,
    RoutingKeys="user.#")  # -> Received, Counter, Timer
panel = Panel(comsumer.Received)
panel_2 = Panel(comsumer_2.Received)
panel_3 = Panel(comsumer_3.Received)
