# Grasshopper definition Consumer.gh (Grasshopper 1.0.7)
# plug-ins: RabbitMQ.GH

# ----
# Consumer setup
host_name = Panel("localhost")
port_number = Panel("5672")
queue_name = Panel("Transforms")
comsumer = Comsumer(Run=Toggle(False), Host=host_name, Port=port_number, Queue=queue_name)
last_received_message = Panel(comsumer)

# ----
# String to rhino conversion
str = StringToRhino(SObjects=last_received_message)  # -> Objects, Errors
conversion_errors = Panel(str.Errors)

# ----
# Rhino objects created
panel = Panel("-0.2 to 0.2")
box = DomainBox(Base=PlaneXY(0, 0, 0), X=panel, Y=panel, Z=panel)
transform = Transform(Geometry=box, Transform=str.Objects)
