# Grasshopper definition Producer.gh (Grasshopper 1.0.7)
# plug-ins: RabbitMQ.GH

# ----
# Rhino objects to send
number_slider = Slider(2, range=0..10)
X = UnitX(Factor=number_slider)
pt = Point(Point(0, 0, 0))
move = Move(Geometry=pt, Motion=X)  # -> Geometry, Transform
rotate = Rotate(Geometry=move.Geometry, Angle=0.7853981634, Plane=PlaneXY(0, 0, 0))  # -> Geometry, Transform
merge = Merge(Data1=move.Transform, Data2=rotate.Transform)
comp = Compound(Transforms=merge)

# ----
# Rhino to string conversion
rts = RhinoToString(Objects=comp)  # -> JsonString, Errors
conversion_errors = Panel(rts.Errors)

# ----
# Producer setup
port_number = Panel("5672")
host_name = Panel("localhost")
message_body = Panel(rts.JsonString)
queue_name = Panel("Transforms")
producer = Producer(Run=Toggle(False), Host=host_name, Port=port_number, Body=message_body, Queue=queue_name)
