# Grasshopper definition Consumer.gh (Grasshopper 1.0.7)
# plug-ins: RabbitMQ.GH

# ----
# Consumer setup
host_name = Panel("localhost")
queue_name = Panel("Transforms")
consumer = Consumer(Run=Toggle(False), Host=host_name, Queue=queue_name)
last_received_message = Panel(consumer)

# ----
# Rhino objects
panel = Panel("-0.2 to 0.2")
box = DomainBox(Base=PlaneXY(0, 0, 0), X=panel, Y=panel, Z=panel)

# ----
# Error handling
python = GhPythonScript(mssg=last_received_message)  # -> out, a
# ---------- python: Python ----------
import rhinoscriptsyntax as rs
if mssg == None or mssg == "Turn on the Run to start consuming" or mssg == "Waiting for messages...":
    a = "0.5,0,0"
else:
    a = mssg
# ---------- end python ----------

move = Move(Geometry=box, Motion=python.a)  # -> Geometry, Transform

# ----
# Visualization
swatch = ColourSwatch(SwatchColor=RGB(114, 161, 166))
preview = CustomPreview(Geometry=box, Material=swatch)
preview_2 = CustomPreview(Geometry=move.Geometry, Material=ColourSwatch(SwatchColor=RGB(166, 137, 114)))
