# Grasshopper definition Producer.gh (Grasshopper 1.0.7)
# plug-ins: RabbitMQ.GH

# ----
# Message generation
python = GhPythonScript()  # -> out, message
# ---------- python: Python ----------
import rhinoscriptsyntax as rs
import random

x = random.randint(1, 6)
y = random.randint(1, 6)
z = random.randint(1, 6)
message = "{},{},{}".format(x,y,z)
# ---------- end python ----------

# ----
# Producer setup
message_body = Panel(python.message)
queue_name = Panel("Transforms")
host_name = Panel("localhost")
producer = Producer(Run=Toggle(False), Host=host_name, Body=message_body, Queue=queue_name)
