# Grasshopper definition Consumer.gh (Grasshopper 1.0.7)
# plug-ins: RabbitMQ.GH

# ----
# Consumer setup
host_name = Panel("localhost")
exchange_name = Panel("routing")
boolean_toggle = BooleanToggle(False)

exchange_type = Panel("1")

# ----
# Consumer 2 -  Circles
routing_keys = Panel("""circle
shape""")
consumer = Consumer(Run=boolean_toggle, Host=host_name, Exchange=exchange_name, ExchangeType=exchange_type, RoutingKeys=routing_keys)
last_received_message = Panel(consumer)

# ----
# Consumer 1 -  Squares
routing_keys_2 = Panel("""square
shape""")
consumer_2 = Consumer(Run=boolean_toggle, Host=host_name, Exchange=exchange_name, ExchangeType=exchange_type, RoutingKeys=routing_keys_2)
last_received_message_2 = Panel(consumer_2)

# ----
# Message processing
# & error handling
python = GhPythonScript(mssg=last_received_message_2)  # -> out, center, side
# ---------- python: Python ----------
import rhinoscriptsyntax as rs
if mssg == None or mssg == "Turn on the Run to start consuming" or mssg == "Waiting for messages...":
    center = "0,0,0"
    side = 0.2
    
else:
    center = "{0},0".format(mssg[:3])
    side = mssg[-1]
# ---------- end python ----------
python_2 = GhPythonScript(mssg=last_received_message)  # -> out, center, diameter
# ---------- python_2: Python ----------
import rhinoscriptsyntax as rs
if mssg == None or mssg == "Turn on the Run to start consuming" or mssg == "Waiting for messages...":
    center = "0,0,0"
    diameter = 0.2
    
else:
    center = "{0},0".format(mssg[:3])
    diameter = mssg[-1]
# ---------- end python_2 ----------

# ----
# Rhino objects
cir = Circle(Plane=python_2.center, Radius=expr("x/2", python_2.diameter))
Z = UnitZ(Factor=1)
dom = ConstructDomain(DomainStart=expr("-x/2", python.side), DomainEnd=expr("x/2", python.side))
move = Move(Geometry=cir, Motion=Z)  # -> Geometry, Transform
rectangle = Rectangle(Plane=python.center, XSize=dom, YSize=dom, Radius=0)  # -> Rectangle, Length

# ----
# Visualization
boundary = BoundarySurfaces(Edges=rectangle.Rectangle)
boundary_2 = BoundarySurfaces(Edges=move.Geometry)
preview = CustomPreview(Geometry=boundary, Material=ColourSwatch(SwatchColor=RGB(114, 161, 166)))
preview_2 = CustomPreview(Geometry=boundary_2, Material=ColourSwatch(SwatchColor=RGB(166, 137, 114)))
