# Grasshopper definition Competing consumers.gh (Grasshopper 1.0.7)
# plug-ins: RabbitMQ.GH

# ----
# Competing consumers setup
host_name = Panel("localhost")
queue_name = Panel("CCQueue")
boolean_toggle = BooleanToggle(False)
boolean_toggle_2 = BooleanToggle(True)

# ----
# Consumer 1
consumer = Consumer(Run=boolean_toggle, Host=host_name, Queue=queue_name, Competing=boolean_toggle_2)
last_received_message = Panel(consumer)

# ----
# Consumer 2
consumer_2 = Consumer(Run=boolean_toggle, Host=host_name, Queue=queue_name, Competing=boolean_toggle_2)
last_received_message_2 = Panel(consumer_2)
