# Grasshopper definition Competing_consumers.gh (Grasshopper 1.0.7)
# plug-ins: RabbitMQ.GH

# ----
# Competing consumers setup
host_name = Panel("localhost")
queue_name = Panel("CCQueue")
boolean_toggle = BooleanToggle(False)
boolean_toggle_2 = BooleanToggle(True)

# ----
# Consumer 1
consumer = Consumer(Run=boolean_toggle, Host=host_name, Queue=queue_name, Competing=boolean_toggle_2)
last_received_message = Panel(consumer)

# ----
# Consumer 2
consumer_2 = Consumer(Run=boolean_toggle, Host=host_name, Queue=queue_name, Competing=boolean_toggle_2)
last_received_message_2 = Panel(consumer_2)

# ----
# Error handling
python = GhPythonScript(mssg=last_received_message)  # -> out, a
# ---------- python: Python ----------
import rhinoscriptsyntax as rs
if mssg == None or mssg == "Turn on the Run to start consuming" or mssg == "Waiting for messages...":
    a = "0,0,0"
else:
    a = mssg
# ---------- end python ----------
python_2 = GhPythonScript(mssg=last_received_message_2)  # -> out, a
# ---------- python_2: Python ----------
import rhinoscriptsyntax as rs
if mssg == None or mssg == "Turn on the Run to start consuming" or mssg == "Waiting for messages...":
    a = "1,0,0"
else:
    a = mssg
# ---------- end python_2 ----------

ln = Line(StartPoint=python.a, EndPoint=python_2.a)

# ----
# Visualization
swatch = ColourSwatch(SwatchColor=RGB(255, 255, 255))
preview = CustomPreview(Geometry=ln, Material=swatch)
