# Grasshopper definition Producer.gh (Grasshopper 1.0.7)
# plug-ins: RabbitMQ.GH

# ----
# Message generation
button = Button()
trigger = Trigger(Interval=50, TimerInterval=50, Target=c_script)  # disabled
c_script = CSharpScript(Reset=button)  # -> out, A; inputs Reset: Boolean
# ---------- c_script: C# usings ----------
using System.Threading;
# ---------- c_script: C# ----------
    // Reset the value of messageId
    if (Reset == true){messageId = 1;}
    
    else{
      // Compose the message body.
      String message = string.Format("This is message No. {0}", messageId);

      // Calculate delay.
      int delay = random.Next(1, 4);
      Thread.Sleep(delay * 1000);


      // Output message
      A = message;

      // Update the id for the next message.
      messageId += 1;
    }
# ---------- c_script: C# additional code ----------
  int messageId = 1;
  Random random = new Random();
# ---------- end c_script ----------

# ----
# Producer setup
message_body = Panel(c_script.A)
queue_name = Panel("CCQueue")
host_name = Panel("localhost")
producer = Producer(Run=Toggle(False), Host=host_name, Body=message_body, Queue=queue_name, Alive=Toggle(True))
