# Grasshopper definition Subscriber.gh (Grasshopper 1.0.7)
# plug-ins: RabbitMQ.GH

# ----
# Subscribers setup
host_name = Panel("localhost")
exchange_name = Panel("pubsub")
boolean_toggle = BooleanToggle(False)

exchange_type = Panel("0")

# ----
# Subscriber 1
consumer = Consumer(Run=boolean_toggle, Host=host_name, Exchange=exchange_name, ExchangeType=exchange_type)
last_received_message = Panel(consumer)

# ----
# Subscriber 2
consumer_2 = Consumer(Run=boolean_toggle, Host=host_name, Exchange=exchange_name, ExchangeType=exchange_type)
last_received_message_2 = Panel(consumer_2)

# ----
# Message processing
# & error handling
python = GhPythonScript(mssg=last_received_message)  # -> out, center, diameter
# ---------- python: Python ----------
import rhinoscriptsyntax as rs
if mssg == None or mssg == "Turn on the Run to start consuming" or mssg == "Waiting for messages...":
    center = "0,0,0"
    diameter = 2
else:
    center = mssg[:5]
    diameter = mssg[-1]
# ---------- end python ----------
python_2 = GhPythonScript(mssg=last_received_message_2)  # -> out, info
# ---------- python_2: Python ----------
import rhinoscriptsyntax as rs
if mssg == None or mssg == "Turn on the Run to start consuming" or mssg == "Waiting for messages...":
    info = "No message received. Defaulting to:\n  >Center: [0,0,0]\n  >Diameter: 1"
    
else:
    info = "Received info:\n  >Center: [{0}]\n  >Diameter: {1}".format(mssg[:5], mssg[-1])
# ---------- end python_2 ----------
panel = Panel(python_2.info)

sph = Sphere(Base=python.center, Radius=expr("x/2", python.diameter))

# ----
# Visualization
swatch = ColourSwatch(SwatchColor=RGBA(255, 255, 255, 38))
preview = CustomPreview(Geometry=sph, Material=swatch)
