# Grasshopper definition Publisher.gh (Grasshopper 1.0.7)
# plug-ins: RabbitMQ.GH

# ----
# Message generation
python = GhPythonScript()  # -> out, message
# ---------- python: Python ----------
import rhinoscriptsyntax as rs
import random

x = random.randint(1, 6)
y = random.randint(1, 6)
z = random.randint(1, 6)
d = random.randint(2, 5)
message = "{},{},{},{}".format(x,y,z,d)
# ---------- end python ----------

# ----
# Producer setup
host_name = Panel("localhost")
message_body = Panel(python.message)
exchange_name = Panel("pubsub")
exchange_name_2 = Panel("0")
producer = Producer(Run=Toggle(False), Host=host_name, Body=message_body, Exchange=exchange_name, ExchangeType=exchange_name_2)
