# Grasshopper definition Subscriber.gh (Grasshopper 1.0.7)
# plug-ins: RabbitMQ.GH

# ----
# Subscribers setup
host_name = Panel("localhost")
exchange_name = Panel("pubsub")
boolean_toggle = BooleanToggle(False)

exchange_type = Panel("0")

# ----
# Subscriber 1
consumer = Consumer(Run=boolean_toggle, Host=host_name, Exchange=exchange_name, ExchangeType=exchange_type)
last_received_message = Panel(consumer)

# ----
# Subscriber 2
consumer_2 = Consumer(Run=boolean_toggle, Host=host_name, Exchange=exchange_name, ExchangeType=exchange_type)
last_received_message_2 = Panel(consumer_2)

# ----
# Message processing
# & error handling
python = GhPythonScript(mssg=last_received_message)  # -> out, center, diameter
# ---------- python: Python ----------
import rhinoscriptsyntax as rs
if mssg == None or mssg == "Turn on the Run to start consuming" or mssg == "Waiting for messages...":
    center = "0,0,0"
    diameter = 2
else:
    center = mssg[:5]
    diameter = mssg[-1]
# ---------- end python ----------
python_2 = GhPythonScript(mssg=last_received_message_2)  # -> out, center, diameter; same code as python
pdecon = Deconstruct(Point=python_2.center)  # -> XComponent, YComponent, ZComponent
pt = ConstructPoint(XCoordinate=expr("-x", pdecon.XComponent), YCoordinate=pdecon.YComponent, ZCoordinate=pdecon.ZComponent)
sph = Sphere(Base=pt, Radius=expr("x/2", python_2.diameter))

sph_2 = Sphere(Base=python.center, Radius=expr("x/2", python.diameter))

# ----
# Visualization
swatch = ColourSwatch(SwatchColor=RGBA(114, 161, 166, 150))
preview = CustomPreview(Geometry=sph_2, Material=swatch)
preview_2 = CustomPreview(Geometry=sph, Material=ColourSwatch(SwatchColor=RGBA(166, 137, 114, 150)))
