# Grasshopper definition Client.gh (Grasshopper 1.0.7)
# plug-ins: RabbitMQ.GH

circle_diameter_to_request_area = Panel("4")

# ----
# Client setup
host_name = Panel("localhost")
queue_name = Panel("request-queue")
client = Client(Run=Toggle(False), Host=host_name, Body=circle_diameter_to_request_area, Queue=queue_name)
last_received_message = Panel(client)

# ----
# Error handling & processing
python = GhPythonScript(mssg=last_received_message)  # -> out, corr_id, area
# ---------- python: Python ----------
import rhinoscriptsyntax as rs
import ast

if mssg == None or mssg == "Turn on the Run to start consuming" or mssg == "Waiting for messages..." or mssg == "Nothing to read yet...":
    area = "No reply received yet"
    corr_id = area
else:
    try:
        corr_id = mssg.split('The requested area for ')[1]
        corr_id = corr_id.split(' is ')[0]
        area = "{:.2f}".format(float(mssg.split('is ')[1]))
    
    except:
        corr_id = 1234
        mssg = mssg.strip('[').strip(']').split(',')
        area = mssg[-1]
# ---------- end python ----------
correlation_id = Panel(python.corr_id)
received_area = Panel(python.area)
