# Grasshopper definition Client.gh (Grasshopper 1.0.7)
# plug-ins: RabbitMQ.GH

panel = Panel("request-exchange")
client = Client(
    Run=Toggle(False),
    Host="rq.desfab.xyz",
    Port=Slider(8432, range=0..10000),
    Body="SomeDataFrom gh2",
    Queue="request_queue",
    Exchange="request_exchange")
panel_2 = Panel(client)

# ----
# Rhino objects
panel_3 = Panel("-0.2 to 0.2")
box = DomainBox(Base=PlaneXY(0, 0, 0), X=panel_3, Y=panel_3, Z=panel_3)

# ----
# Error handling
python = GhPythonScript()  # -> out, a
# ---------- python: Python ----------
import rhinoscriptsyntax as rs
if mssg == None or mssg == "Turn on the Run to start consuming" or mssg == "Waiting for messages...":
    a = "0.5,0,0"
else:
    a = mssg
# ---------- end python ----------

move = Move(Geometry=box, Motion=python.a)  # -> Geometry, Transform

# ----
# Visualization
swatch = ColourSwatch(SwatchColor=RGB(114, 161, 166))
preview = CustomPreview(Geometry=box, Material=swatch)
preview_2 = CustomPreview(Geometry=move.Geometry, Material=ColourSwatch(SwatchColor=RGB(166, 137, 114)))

# ----
# Client setup
host_name = Panel("localhost")
queue_name = Panel("request-queue")

client_2 = Client(Run=Toggle(False), Host=host_name, Body="4", Queue=queue_name)

last_received_message = Panel(client_2)
