# Grasshopper definition Server.gh (Grasshopper 1.0.7)
# plug-ins: RabbitMQ.GH

c_script = CSharpScript(Reference=["C:\Users\jdfra\AppData\Roaming\Grasshopper\Libraries\RabbitMQ\Newtonsoft.Json.dll", "C:\Users\jdfra\AppData\Roaming\Grasshopper\Libraries\RabbitMQ\RabbitMQ.Client.dll", "C:\Users\jdfra\AppData\Roaming\Grasshopper\Libraries\RabbitMQ\RabbitMQ.Core.dll", "C:\Users\jdfra\AppData\Roaming\Grasshopper\Libraries\RabbitMQ\System.Buffers.dll", "C:\Users\jdfra\AppData\Roaming\Grasshopper\Libraries\RabbitMQ\System.Memory.dll", "C:\Users\jdfra\AppData\Roaming\Grasshopper\Libraries\RabbitMQ\System.Numerics.Vectors.dll", "C:\Users\jdfra\AppData\Roaming\Grasshopper\Libraries\RabbitMQ\System.Runtime.CompilerServices.Unsafe.dll", "C:\Users\jdfra\AppData\Roaming\Grasshopper\Libraries\RabbitMQ\System.Threading.Channels.dll", "C:\Users\jdfra\AppData\Roaming\Grasshopper\Libraries\RabbitMQ\System.Threading.Tasks.Extensions.dll"])  # -> out, circle
# ---------- c_script: C# usings ----------
using RabbitMQ.Core;
using System.Linq;
using RabbitMQ.Client;
using RabbitMQ.Client.Events;
using Newtonsoft.Json;
using System.Text;
# ---------- c_script: C# ----------
    // Asign the custom handler to the component´s output.
    circle = costumHandler;
# ---------- c_script: C# additional code ----------
  // Declare and initialize the custom handler.
  public RabbitMQ.Core.Handler costumHandler = new CostumHandler();

  // Define the CustomHandler class.
  public class CostumHandler:RabbitMQ.Core.Handler
  {
    // Inherited constructor.
    public CostumHandler() : base() { }

    // Override the parent´s HandleMessage method with custom implementation.
    public override List<object> HandleMessage(string body)
    {

      // Deserialize the recieved message.
      double radius = JsonConvert.DeserializeObject<double>(body);

      // Process the received information.
      var circle = new Circle(new Point3d(0, 0, 0), radius);

      // The returned value most be list of objects.
      // Wrap the object(s) to return in a list.
      List < object > objects = new List<object>();
      objects.Add(circle);
      
      objects.Add(Math.PI * radius * radius);

      return objects;

    }
  }
# ---------- end c_script ----------

# ----
# Server setup
host_name = Panel("localhost")
queue_name = Panel("request-queue")
server = Server(Run=Toggle(False), Host=host_name, Queue=queue_name, Handler=c_script.circle)
panel = Panel(server)

# ----
# Visualization
python = GhPythonScript(mssg=server)  # -> out, area, circle; inputs mssg: list
# ---------- python: Python ----------
import rhinoscriptsyntax as rs
import Rhino.Geometry as rg
import math

if mssg[0] == "Turn on the Run to start consuming" or mssg[0] == "Waiting for messages...":
    circle = rg.Circle(rg.Point3d(0,0,0), 0.5)

else:
    circle = rs.coercegeometry(mssg[0])
area = str(math.pi*circle.Radius**2)
# ---------- end python ----------

# ----
# Visualization
swatch = ColourSwatch(SwatchColor=RGB(114, 161, 166))
area = Panel(python.area)
boundary = BoundarySurfaces(Edges=python.circle)
preview = CustomPreview(Geometry=boundary, Material=swatch)
