# Grasshopper definition Server.gh (Grasshopper 1.0.7)
# plug-ins: RabbitMQ.GH

c_script = CSharpScript(Reference=["C:\Users\jdfra\AppData\Roaming\Grasshopper\Libraries\RabbitMQ\Newtonsoft.Json.dll", "C:\Users\jdfra\AppData\Roaming\Grasshopper\Libraries\RabbitMQ\RabbitMQ.Client.dll", "C:\Users\jdfra\AppData\Roaming\Grasshopper\Libraries\RabbitMQ\RabbitMQ.Core.dll", "C:\Users\jdfra\AppData\Roaming\Grasshopper\Libraries\RabbitMQ\System.Buffers.dll", "C:\Users\jdfra\AppData\Roaming\Grasshopper\Libraries\RabbitMQ\System.Memory.dll", "C:\Users\jdfra\AppData\Roaming\Grasshopper\Libraries\RabbitMQ\System.Numerics.Vectors.dll", "C:\Users\jdfra\AppData\Roaming\Grasshopper\Libraries\RabbitMQ\System.Runtime.CompilerServices.Unsafe.dll", "C:\Users\jdfra\AppData\Roaming\Grasshopper\Libraries\RabbitMQ\System.Threading.Channels.dll", "C:\Users\jdfra\AppData\Roaming\Grasshopper\Libraries\RabbitMQ\System.Threading.Tasks.Extensions.dll"])  # -> out, A
# ---------- c_script: C# usings ----------
using RabbitMQ.Core;
using System.Linq;
using RabbitMQ.Client;
using RabbitMQ.Client.Events;
using Newtonsoft.Json;
using System.Text;
# ---------- c_script: C# ----------
    A = costumHandler;
# ---------- c_script: C# additional code ----------
  public RabbitMQ.Core.Handler costumHandler = new CostumHandler();

  public class CostumHandler:RabbitMQ.Core.Handler
  {

    public CostumHandler() : base() { }

    public override List<object> HandleMessage(string body)
    {

      // What do i get
      var radius = JsonConvert.DeserializeObject<double>(body);

      var sphere = new Sphere(new Point3d(0, 0, 0), radius);

      List < object > objects = new List<object>();

      objects.Add(sphere);

      return objects;

    }
  }
# ---------- end c_script ----------

# ----
# Server setup
host_name = Panel("localhost")
queue_name = Panel("request-queue")
server = Server(Run=Toggle(False), Host=host_name, Queue=queue_name, Handler=c_script.A)
panel = Panel(server)

geo = Geometry(server)
