# Grasshopper definition Consumer.gh (Grasshopper 1.0.7)
# plug-ins: RabbitMQ.GH

# ----
# Consumer setup
host_name = Panel("localhost")
exchange_name = Panel("topic")
boolean_toggle = BooleanToggle(False)

exchange_type = Panel("2")

# ----
# Consumer 2 -  Perimeter
routing_keys = Panel("square.perimeter")
consumer = Consumer(Run=boolean_toggle, Host=host_name, Exchange=exchange_name, ExchangeType=exchange_type, RoutingKeys=routing_keys)
last_received_message = Panel(consumer)

# ----
# Consumer 3 -  General
routing_keys_2 = Panel("square.*")
consumer_2 = Consumer(Run=boolean_toggle, Host=host_name, Exchange=exchange_name, ExchangeType=exchange_type, RoutingKeys=routing_keys_2)
last_received_message_2 = Panel(consumer_2)

# ----
# Consumer 1 -  Area
routing_keys_3 = Panel("square.area")
consumer_3 = Consumer(Run=boolean_toggle, Host=host_name, Exchange=exchange_name, ExchangeType=exchange_type, RoutingKeys=routing_keys_3)
last_received_message_3 = Panel(consumer_3)

# ----
# Message processing
# & error handling
python = GhPythonScript(mssg=last_received_message_3)  # -> out, side, area
# ---------- python: Python ----------
import rhinoscriptsyntax as rs
if mssg == None or mssg == "Turn on the Run to start consuming" or mssg == "Waiting for messages...":
    side = 1
    
else:
    side = mssg[0]

area = float(side)**2
# ---------- end python ----------
python_2 = GhPythonScript(mssg=last_received_message)  # -> out, side, perimeter
# ---------- python_2: Python ----------
import rhinoscriptsyntax as rs
if mssg == None or mssg == "Turn on the Run to start consuming" or mssg == "Waiting for messages...":
    side = 1
    
else:
    side = mssg[0]
    
perimeter = float(side)*4
# ---------- end python_2 ----------
python_3 = GhPythonScript(mssg=last_received_message_2)  # -> out, side, area, perimeter
# ---------- python_3: Python ----------
import rhinoscriptsyntax as rs
if mssg == None or mssg == "Turn on the Run to start consuming" or mssg == "Waiting for messages...":
    side = 1
    
else:
    side = mssg[0]
    
area = float(side)**2
perimeter = float(side)*4
# ---------- end python_3 ----------
area = Panel(python.area)
perimeter = Panel(python_2.perimeter)
area_perimeter = Panel([python_3.area, python_3.perimeter])

# ----
# Rhino objects
dom = ConstructDomain(DomainStart=expr("-x/2", python.side), DomainEnd=expr("x/2", python.side))
dom_2 = ConstructDomain(DomainStart=expr("-x/2", python_2.side), DomainEnd=expr("x/2", python_2.side))
dom_3 = ConstructDomain(DomainStart=expr("-x/2", python_3.side), DomainEnd=expr("x/2", python_3.side))
rectangle = Rectangle(Plane="0,0,0", XSize=dom, YSize=dom, Radius=0)  # -> Rectangle, Length
rectangle_2 = Rectangle(Plane="0,0,2", XSize=dom_2, YSize=dom_2, Radius=0)  # -> Rectangle, Length
rectangle_3 = Rectangle(Plane="0,0,4", XSize=dom_3, YSize=dom_3, Radius=0)  # -> Rectangle, Length

# ----
# Visualization
boundary = BoundarySurfaces(Edges=rectangle.Rectangle)
boundary_2 = BoundarySurfaces(Edges=rectangle_2.Rectangle)
boundary_3 = BoundarySurfaces(Edges=rectangle_3.Rectangle)
preview = CustomPreview(Geometry=boundary, Material=ColourSwatch(SwatchColor=RGB(114, 161, 166)))
preview_2 = CustomPreview(Geometry=boundary_2, Material=ColourSwatch(SwatchColor=RGB(166, 137, 114)))
preview_3 = CustomPreview(Geometry=boundary_3, Material=ColourSwatch(SwatchColor=RGB(166, 114, 128)))
