# Grasshopper definition Producer.gh (Grasshopper 1.0.7)
# plug-ins: RabbitMQ.GH

# ----
# Message generation
python = GhPythonScript()  # -> out, message, routing_key
# ---------- python: Python ----------
import rhinoscriptsyntax as rs
import random

# Define the message to send
l = random.randint(1, 6)
message = "{}".format(l)

# Select the routing key to use when sending the message.
routing_keys = ['square.perimeter', 'square.area']
routing_key = routing_keys[random.randint(0, len(routing_keys)-1)]
# ---------- end python ----------

# ----
# Producer setup
host_name = Panel("localhost")
message_body = Panel(python.message)
exchange_name = Panel("topic")
exchange_type = Panel("2")
routing_key = Panel(python.routing_key)
producer = Producer(
    Run=Toggle(False),
    Host=host_name,
    Body=message_body,
    Exchange=exchange_name,
    ExchangeType=exchange_type,
    RoutingKeys=routing_key)
